# Grasshopper definition carrara_ff.gh (Grasshopper 1.0.8)

path = FilePath("C:\Users\slantis-temp\Desktop\git\carrara_ff\carrara_ff.py")
# if raw_breps:
#     bbox = union_bbox(raw_breps)
#     aligned_breps = move_to_origin(raw_breps, bbox.Min)
#     pieces = slice_by_angles(aligned_breps, angles)
#     names_out = name_pieces(pieces, layer_name)
#     geo_out = recenter_each(pieces)
# else:
#     geo_out = []
#     names_out = []
geo = Geometry(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)
file = ReadFile(File=path, PerLineParse=False)
py3 = Python3Script(script=file, layer_name="00 - Carrara")  # -> out, a, raw_objs, bbox, moved_objs, oriented_pieces; inputs layer_name: String; unedited script template
geo_2 = Geometry(py3.oriented_pieces)
item = ListItem(List=geo_2, Index=Slider(0, range=0..360), Wrap=True)
panel = Panel(py3.out)
